# Grasshopper definition toolpath diagrams.gh (Grasshopper 1.0.7)

# ---- group: input geometry
brep = Brep(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)

# ---- group: plane sub division
sdivide = DivideSurface(Surface=brep, UCount=Slider(54, range=0..100), VCount=Slider(20, range=0..20))  # -> Points, Normals, Parameters
flip = FlipMatrix(Data=sdivide.Points)
pline = PolyLine(Vertices=flip, Closed=False)  # -> flatten(Polyline)

# ---- group: toolpath generation
dispatch = Dispatch(List=pline, DispatchPattern=[True, False])  # -> ListA, ListB
flip_2 = FlipCurve(Curve=dispatch.ListB)  # -> Curve, Flag
end = EndPoints(Curve=dispatch.ListA)  # -> Start, End
end_2 = EndPoints(Curve=flip_2.Curve)  # -> Start, End
weave = Weave(Pattern=[0, 1], Stream0=end.Start, Stream1=end_2.End, NullGaps=False)
weave_2 = Weave(Pattern=[0, 1], Stream0=end.End, Stream1=end_2.Start, NullGaps=False)
pline_2 = PolyLine(Vertices=weave, Closed=False)
pline_3 = PolyLine(Vertices=weave_2, Closed=False)
explode = Explode(Curve=pline_2, Recursive=True)  # -> Segments, Vertices
explode_2 = Explode(Curve=pline_3, Recursive=True)  # -> Segments, Vertices
dispatch_2 = Dispatch(List=explode.Segments, DispatchPattern=[True, False])  # -> ListA, ListB
dispatch_3 = Dispatch(List=explode_2.Segments, DispatchPattern=[True, False])  # -> ListA, ListB
crv = Curve(dispatch_3.ListB)
crv_2 = Curve(dispatch_2.ListA)
join = JoinCurves(Curves=[pline, crv_2, crv], Preserve=False)

# ---- group: points
disc = Discontinuity(Curve=join, Level=3)  # -> flatten(Points), Parameters
X = UnitX(Factor=1)
project = ProjectPoint(Point=disc.Points, Direction=X, Geometry=brep)  # -> Point, Index

# ---- group: vect relative to north
Y = UnitY(Factor=1)
line = LineSDL(Start=project.Point, Direction=Y, Length=1)
end_3 = EndPoints(Curve=line)  # -> Start, End
vec2pt = Vector2Pt(PointA=disc.Points, PointB=project.Point, Unitize=False)  # -> Vector, Length
vec2pt_2 = Vector2Pt(PointA=end_3.Start, PointB=end_3.End, Unitize=False)  # -> Vector, Length
angle = Angle(VectorA=vec2pt_2.Vector, VectorB=vec2pt.Vector)  # -> Angle, Reflex

# ----
pdecon = Deconstruct(Point=project.Point)  # -> XComponent, YComponent, ZComponent

concat = Concatenate(
    FragmentA="[",
    FragmentB=pdecon.XComponent,
    FragmentC=",",
    FragmentD=pdecon.YComponent,
    FragmentE=",",
    FragmentF=pdecon.ZComponent,
    FragmentG=",",
    FragmentH=angle.Angle,
    FragmentI="]")
panel = Panel("""#points and vectors
#
Pi=3.14""")
concat_2 = Concatenate(FragmentA=concat, FragmentB=",")
merge = Merge(Data1=panel, Data2="points = [", Data3=concat_2, Data4="]")

# ----
# Set internal data stream file destination
# to output tool path as .TXT
panel_2 = Panel(merge)
